# Dynamo graph Listatlevel.dyn (Dynamo 1.2.0.2690)

origin = Point.Origin()
code_block = CodeBlock { 0; 4; 1; }
range = Range(start=code_block.out0, end=code_block.out1, step=code_block.out2, lacing=Longest)
byCoordinates = Vector.ByCoordinates(x=range, y=code_block.out0, z=code_block.out0)
translate = Geometry.Translate(geometry=origin, direction=byCoordinates, lacing=Longest)
byCoordinates_2 = Vector.ByCoordinates(x=code_block.out0, y=range, z=code_block.out0)
translate_2 = Geometry.Translate(geometry=translate, direction=byCoordinates_2, lacing=CrossProduct)
byCoordinates_3 = Vector.ByCoordinates(x=code_block.out0, y=code_block.out0, z=range)
translate_3 = Geometry.Translate(geometry=translate_2, direction=byCoordinates_3, lacing=CrossProduct)
code_block_2 = CodeBlock { 0; }
getItemAtIndex = List.GetItemAtIndex(list=translate_3@L2, index=code_block_2)
